% Simulink data dictionary params.sldd

Ts = Simulink.Parameter(0.001, DataType="double")
iamax = Simulink.Parameter(10, StorageClass="Struct", Alias="maxCurrent", StructName="controlParams", DataType="single")
maxdelta = Simulink.Parameter(Simulink.data.Expression(ExpressionString="20/180*pi"), StorageClass="Struct", Alias="maxSteer", StructName="controlParams", DataType="single")
deltaNgain = Simulink.Parameter(100, StorageClass="Struct", Alias="filtGainSteerCtrl", StructName="controlParams", DataType="single")
deltaDgain = Simulink.Parameter(0, StorageClass="Struct", Alias="derGainSteerCtrl", StructName="controlParams", DataType="single")
deltaPgain = Simulink.Parameter(200, StorageClass="Struct", Alias="propGainSteerCtrl", StructName="controlParams", DataType="single")
deltaRefGain = Simulink.Parameter(Simulink.data.Expression(ExpressionString="5/180*pi"), StorageClass="Struct", Alias="deltaRefGain", StructName="controlParams", DataType="single")
deltaIgain = Simulink.Parameter(50, StorageClass="Struct", Alias="intGainSteerCtrl", StructName="controlParams", DataType="single")
phi0 = Simulink.Parameter(0.1, StorageClass="Struct", Alias="rollSmall", StructName="controlParams", DataType="single")
phisat = Simulink.Parameter(0.5, StorageClass="Struct", Alias="rollSaturation", StructName="controlParams", DataType="single")
V0 = Simulink.Parameter(0.1, StorageClass="Struct", Alias="speedSmall", StructName="controlParams", DataType="single")
g = Simulink.Parameter(9.806, StorageClass="Struct", Alias="gravity", StructName="controlParams", DataType="single")